% Simulink data dictionary Project_ESC_Data_Dictionary.sldd

Conversion_Of_DegToRad = Simulink.Parameter(0.0175, DataType="single")
Mass_Of_Front_Axle = Simulink.Parameter(640, DataType="uint16")
Mass_Of_Rear_Axle = Simulink.Parameter(642, DataType="uint16")
Mass_of_Vehicle = Simulink.Parameter(1164, DataType="uint16")
Steering_Status_Left = Simulink.Parameter(10, DataType="uint8")
Steering_Status_Right = Simulink.Parameter(5, DataType="uint8")
Two = Simulink.Parameter(2, DataType="uint8")
Wheel_ID_Front_Left = Simulink.Parameter(2, DataType="uint8")
Wheel_ID_Front_Right = Simulink.Parameter(1, DataType="uint8")
Wheel_ID_NA = Simulink.Parameter(10, DataType="uint8")
Wheel_ID_Rear_Left = Simulink.Parameter(4, DataType="uint8")
Wheel_ID_Rear_Right = Simulink.Parameter(3, DataType="uint8")
Wheelbase = Simulink.Parameter(2.422, DataType="single")
ABS_Status__ABS_Deactive = Simulink.Parameter(0, DataType="boolean")
ABS_Status__ABS_Active = Simulink.Parameter(1, DataType="boolean")
ESC_Status_Understeer = 2
ESC_Status_Oversteer = 1
ESC_Status_Neutral = 0
Negligible_Value = Simulink.Parameter(0.0001, DataType="single")
Steering_Status_Neutral = Simulink.Parameter(0, DataType="uint8")
Rad_Theshold_Value = Simulink.Parameter(30, DataType="uint8")
ONE = Simulink.Parameter(1, DataType="uint8")
Vel_Theshold_Value = Simulink.Parameter(16.66, DataType="single")
ESC_On_Off = Simulink.Signal(DataType="boolean")
Velocity_of_Car = Simulink.Signal(DataType="single")
Radius = Simulink.Signal(DataType="single")
Steering_Angle_Sensor = Simulink.Signal(DataType="single")
Theshold_Value_Of_Engine_Speed = Simulink.Parameter(10, DataType="single")
DTC_Activated = Simulink.Parameter(1, DataType="single")
DTC_Not_Activated = Simulink.Parameter(0, DataType="single")
ESC_System_Off = Simulink.Parameter(0, DataType="single")
ZERO = Simulink.Parameter(0)