test file "Copy_of_Final_ESC_System"
  coverage: MCDC

suite "MIL"

  case "Functional_Test" [baseline]
    test data file: Copy_of_Final_ESC_System.xlsx
    model Copy_of_Final_ESC_System, harness Copy_of_Final_ESC_System_Harness
    parameter set "Parameter Set 1":
      ABS_Status__ABS_Active = 1  % New_ESC_Dictionary.sldd
      ABS_Status__ABS_Deactive = 0  % New_ESC_Dictionary.sldd
      Conversion_Of_DegToRad = 0.0175  % New_ESC_Dictionary.sldd
      DTC_Activated = 1  % New_ESC_Dictionary.sldd
      DTC_Not_Activated = 0  % New_ESC_Dictionary.sldd
      ESC_On_Off = 1x1 Simulink.Signal  % New_ESC_Dictionary.sldd
      ESC_Status_Neutral = 0  % New_ESC_Dictionary.sldd
      ESC_Status_Oversteer = 1  % New_ESC_Dictionary.sldd
      ESC_Status_Understeer = 2  % New_ESC_Dictionary.sldd
      Mass_Of_Front_Axle = 640  % New_ESC_Dictionary.sldd
      Mass_Of_Rear_Axle = 642  % New_ESC_Dictionary.sldd
      Mass_of_Vehicle = 1164  % New_ESC_Dictionary.sldd
      Negligible_Value = 0.0001  % New_ESC_Dictionary.sldd
      ONE = 1  % New_ESC_Dictionary.sldd
      Radius = 1x1 Simulink.Signal  % New_ESC_Dictionary.sldd
      Steering_Angle_Sensor = 1x1 Simulink.Signal  % New_ESC_Dictionary.sldd
      Steering_Status_Left = 10  % New_ESC_Dictionary.sldd
      Steering_Status_Neutral = 0  % New_ESC_Dictionary.sldd
      Steering_Status_Right = 5  % New_ESC_Dictionary.sldd
      Two = 2  % New_ESC_Dictionary.sldd
      Vel_Theshold_Value = 16.66  % New_ESC_Dictionary.sldd
      Velocity_of_Car = 1x1 Simulink.Signal  % New_ESC_Dictionary.sldd
      Wheel_ID_Front_Left = 2  % New_ESC_Dictionary.sldd
      Wheel_ID_Front_Right = 1  % New_ESC_Dictionary.sldd
      Wheel_ID_NA = 10  % New_ESC_Dictionary.sldd
      Wheel_ID_Rear_Left = 4  % New_ESC_Dictionary.sldd
      Wheel_ID_Rear_Right = 3  % New_ESC_Dictionary.sldd
      Wheelbase = 2.422  % New_ESC_Dictionary.sldd
      ZERO = 0  % New_ESC_Dictionary.sldd
    input "Test" from Copy_of_Final_ESC_System.xlsx, mapped to ESC_On_Off, Velocity_of_Car, Radius, Steering_Angle_Sensor (active)
    logged signals "Signal Set 1": ESC_System_Status, Acceleration, Wheel_Brake_Output, ABS_Output, DTC_Status
    baseline "Test"
      Acceleration
      DTC_Status
      ESC_System_Status
      Wheel_Brake_Output
      ABS_Output
      ESC_System_Status
      Acceleration
      Wheel_Brake_Output
      ABS_Output
      DTC_Status

suite "SIL"

  case "Equivalence_Test" [equivalence]
    simulation 1:
      model Copy_of_Final_ESC_System, harness Copy_of_Final_ESC_System_Harness, mode Normal
      parameter set "Parameter Set 1":
        ABS_Status__ABS_Active = 1  % New_ESC_Dictionary.sldd
        ABS_Status__ABS_Deactive = 0  % New_ESC_Dictionary.sldd
        Conversion_Of_DegToRad = 0.0175  % New_ESC_Dictionary.sldd
        DTC_Activated = 1  % New_ESC_Dictionary.sldd
        DTC_Not_Activated = 0  % New_ESC_Dictionary.sldd
        ESC_On_Off = 1x1 Simulink.Signal  % New_ESC_Dictionary.sldd
        ESC_Status_Neutral = 0  % New_ESC_Dictionary.sldd
        ESC_Status_Oversteer = 1  % New_ESC_Dictionary.sldd
        ESC_Status_Understeer = 2  % New_ESC_Dictionary.sldd
        Mass_Of_Front_Axle = 640  % New_ESC_Dictionary.sldd
        Mass_Of_Rear_Axle = 642  % New_ESC_Dictionary.sldd
        Mass_of_Vehicle = 1164  % New_ESC_Dictionary.sldd
        Negligible_Value = 0.0001  % New_ESC_Dictionary.sldd
        ONE = 1  % New_ESC_Dictionary.sldd
        Radius = 1x1 Simulink.Signal  % New_ESC_Dictionary.sldd
        Steering_Angle_Sensor = 1x1 Simulink.Signal  % New_ESC_Dictionary.sldd
        Steering_Status_Left = 10  % New_ESC_Dictionary.sldd
        Steering_Status_Neutral = 0  % New_ESC_Dictionary.sldd
        Steering_Status_Right = 5  % New_ESC_Dictionary.sldd
        Two = 2  % New_ESC_Dictionary.sldd
        Vel_Theshold_Value = 16.66  % New_ESC_Dictionary.sldd
        Velocity_of_Car = 1x1 Simulink.Signal  % New_ESC_Dictionary.sldd
        Wheel_ID_Front_Left = 2  % New_ESC_Dictionary.sldd
        Wheel_ID_Front_Right = 1  % New_ESC_Dictionary.sldd
        Wheel_ID_NA = 10  % New_ESC_Dictionary.sldd
        Wheel_ID_Rear_Left = 4  % New_ESC_Dictionary.sldd
        Wheel_ID_Rear_Right = 3  % New_ESC_Dictionary.sldd
        Wheelbase = 2.422  % New_ESC_Dictionary.sldd
        ZERO = 0  % New_ESC_Dictionary.sldd
      input "Test" from Copy_of_Final_ESC_System.xlsx, mapped to ESC_On_Off, Velocity_of_Car, Radius, Steering_Angle_Sensor (active)
      logged signals "Signal Set 1": ESC_System_Status, Acceleration, Wheel_Brake_Output, ABS_Output, DTC_Status
    simulation 2:
      model Copy_of_Final_ESC_System, harness Copy_of_Final_ESC_System_Harness, mode Software-in-the-Loop (SIL)
      parameter set "Parameter Set 1":
        ABS_Status__ABS_Active = 1  % New_ESC_Dictionary.sldd
        ABS_Status__ABS_Deactive = 0  % New_ESC_Dictionary.sldd
        Conversion_Of_DegToRad = 0.0175  % New_ESC_Dictionary.sldd
        DTC_Activated = 1  % New_ESC_Dictionary.sldd
        DTC_Not_Activated = 0  % New_ESC_Dictionary.sldd
        ESC_On_Off = 1x1 Simulink.Signal  % New_ESC_Dictionary.sldd
        ESC_Status_Neutral = 0  % New_ESC_Dictionary.sldd
        ESC_Status_Oversteer = 1  % New_ESC_Dictionary.sldd
        ESC_Status_Understeer = 2  % New_ESC_Dictionary.sldd
        Mass_Of_Front_Axle = 640  % New_ESC_Dictionary.sldd
        Mass_Of_Rear_Axle = 642  % New_ESC_Dictionary.sldd
        Mass_of_Vehicle = 1164  % New_ESC_Dictionary.sldd
        Negligible_Value = 0.0001  % New_ESC_Dictionary.sldd
        ONE = 1  % New_ESC_Dictionary.sldd
        Radius = 1x1 Simulink.Signal  % New_ESC_Dictionary.sldd
        Steering_Angle_Sensor = 1x1 Simulink.Signal  % New_ESC_Dictionary.sldd
        Steering_Status_Left = 10  % New_ESC_Dictionary.sldd
        Steering_Status_Neutral = 0  % New_ESC_Dictionary.sldd
        Steering_Status_Right = 5  % New_ESC_Dictionary.sldd
        Two = 2  % New_ESC_Dictionary.sldd
        Vel_Theshold_Value = 16.66  % New_ESC_Dictionary.sldd
        Velocity_of_Car = 1x1 Simulink.Signal  % New_ESC_Dictionary.sldd
        Wheel_ID_Front_Left = 2  % New_ESC_Dictionary.sldd
        Wheel_ID_Front_Right = 1  % New_ESC_Dictionary.sldd
        Wheel_ID_NA = 10  % New_ESC_Dictionary.sldd
        Wheel_ID_Rear_Left = 4  % New_ESC_Dictionary.sldd
        Wheel_ID_Rear_Right = 3  % New_ESC_Dictionary.sldd
        Wheelbase = 2.422  % New_ESC_Dictionary.sldd
        ZERO = 0  % New_ESC_Dictionary.sldd
      input "Test" from Copy_of_Final_ESC_System.xlsx, mapped to ESC_On_Off, Velocity_of_Car, Radius, Steering_Angle_Sensor (active)
      logged signals "Signal Set 1": ESC_System_Status, Acceleration, Wheel_Brake_Output, ABS_Output, DTC_Status
    equivalence criteria
      ESC_System_Status
      Acceleration
      Wheel_Brake_Output
      ABS_Output
      DTC_Status
      ESC_System_Status
      Acceleration
      Wheel_Brake_Output
      ABS_Output
      DTC_Status